# Grasshopper definition ReferenceSurface_Pattern.gh (Grasshopper 1.0.7)
# plug-ins: TopoGrasshopper Info

number_slider = Slider(40, range=0..100)
hexgrid = Hexagonal(Plane=PlaneXY(0, 0, 0), Size=Slider(0.06, range=0..1), ExtentX=number_slider, ExtentY=number_slider)  # -> flatten(Cells), flatten(Points)
python = GhPythonScript(Pts=hexgrid.Points)  # -> ct; inputs Pts: list of Point3d
# ---------- python: Python ----------
__author__ = "ziqwang"

import rhinoscriptsyntax as rs

ct = rs.CreatePoint(0, 0, 0)
for pt in Pts:
    ct = ct + pt
    
ct /= -len(Pts)
# ---------- end python ----------
move = Move(Geometry=hexgrid.Cells, Motion=python)  # -> flatten(Geometry), Transform

# ----
# Reference Surface & Pattern
inittopo = InitTopo(Reset=Button())

mesh = Mesh(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)
tri = Triangulate(Mesh=mesh)  # -> Mesh, Count

# ----
# Restart the TopoCreator (Do once before starting the program)
# Set the reference surface
# Input Triangle Mesh
# Set the pattern
# A Example of Generating 2D Hexagonal Pattern
modifyreferencemesh = ModifyReferenceMesh(APointerOfTopoCreator=inittopo, ReferenceMesh=tri.Mesh)
modifypattern = ModifyPattern(APointerOfTopoCreator=modifyreferencemesh, PatternLine=move.Geometry)

# ----
# Parameter Lists:
# 1. tiltAngle
# 2. cutUpper
# 3. cutLower
# 4. patternID (don't change it if you use your own pattern)
# 5. patternAngle
# 6. patternXY (A Point)
# 7. patternScale
number_slider_2 = Slider(1, range=0..5)
modifypara = ModifyPara(APointerOfTopoCreator=modifypattern, Name="patternScale", Value=number_slider_2)

# ----
# Set Parameters
modifypara_2 = ModifyPara(APointerOfTopoCreator=modifypara, Name="cutLower", Value=Slider(0.05, range=0..5))

modifypara_3 = ModifyPara(APointerOfTopoCreator=modifypara_2, Name="cutUpper", Value=Slider(0.1, range=0..5))

modifypara_4 = ModifyPara(APointerOfTopoCreator=modifypara_3, Name="patternAngle", Value=Slider(96.75, range=-180..180))

# ----
# Create Parts' Geometry
draw2dtexturemesh = Draw2DTextureMesh(TopoPtr=modifypara_4)
drawpatternmesh = DrawPatternMesh(TopoPtr=modifypara_4)
drawbasemesh2d = DrawBaseMesh2D(TopoPtr=modifypara_4)
drawstructure = DrawStructure(TopoPtr=modifypara_4, Preview=Toggle(True))  # -> Part, Boundary
drawcrossmesh = DrawCrossMesh(TopoPtr=modifypara_4)
