# Grasshopper definition ghexample.gh (Grasshopper 1.0.7)
# plug-ins: TopoGrasshopper Info

pwd = VBScript()  # -> out, Path
# ---------- pwd: VB ----------
    Dim gh_d As GH_Document = owner.OnPingDocument()

    If gh_d.IsFilePathDefined Then
      Print("A path is defined.")
      Path = gh_d.FilePath
    Else
      Print("No path defined.")
    End If
# ---------- end pwd ----------
relative_exact = GhPythonScript(A=pwd.Path, B="model/fig_teaser/origin.xml")  # -> Path
# ---------- relative_exact: Python ----------
__author__ = "ziqwang"

import rhinoscriptsyntax as rs

import os

Path = os.path.join(os.path.dirname(A), os.path.normpath(B))
# ---------- end relative_exact ----------
topoxmlreader = TopoXMLReader(XMLFile=relative_exact)

modifypara = ModifyPara(APointerOfTopoCreator=topoxmlreader, Name="tiltAngle", Value=Slider(41, range=0..80))
modifypara_2 = ModifyPara(APointerOfTopoCreator=modifypara, Name="cutUpper", Value=Slider(0.02, range=0..0.2))
modifypara_3 = ModifyPara(APointerOfTopoCreator=modifypara_2, Name="cutLower", Value=Slider(0.02, range=0..0.2))
modifypara_4 = ModifyPara(APointerOfTopoCreator=modifypara_3, Name="patternAngle", Value=Slider(-5.2, range=-20..20))
vec = VectorXYZ(XComponent=Slider(0, range=0..2), YComponent=Slider(0, range=0..2), ZComponent=0)  # -> Vector, Length
modifypara_5 = ModifyPara(APointerOfTopoCreator=modifypara_4, Name="patternXY", Value=vec.Vector)
modifypara_6 = ModifyPara(APointerOfTopoCreator=modifypara_5, Name="patternScale", Value=Slider(1, range=0..2))
modifypara_7 = ModifyPara(APointerOfTopoCreator=modifypara_6, Name="patternID", Value=Slider(5, range=1..11))

drawstructure = DrawStructure(TopoPtr=modifypara_7, Preview=Toggle(True))  # -> Part, Boundary
rgb = ColourRGB(Alpha="150", Red="150", Green="150", Blue="150")
rgb_2 = ColourRGB(Alpha="250", Red="250", Green="250", Blue="250")
material = CreateMaterial(Diffuse=rgb, Specular=rgb, Emission=rgb, Transparency=0, Shine=0)
material_2 = CreateMaterial(Diffuse=rgb_2, Specular=rgb_2, Emission=rgb_2, Transparency=0, Shine=0)
drawpatternmesh = DrawPatternMesh(TopoPtr=modifypara_7)
drawcrossmesh = DrawCrossMesh(TopoPtr=modifypara_7)
draw2dtexturemesh = Draw2DTextureMesh(TopoPtr=modifypara_7)
drawbasemesh2d = DrawBaseMesh2D(TopoPtr=modifypara_7)
pt = Point(Point(0, 2.5, 0))
pt_2 = Point(Point(2.5, 0, 0))
move = Move(Geometry=drawstructure.Part, Motion=pt_2)  # -> Geometry, Transform
move_2 = Move(Geometry=drawstructure.Boundary, Motion=pt_2)  # -> Geometry, Transform
wireframe = FaceBoundaries(Mesh=[move.Geometry, move_2.Geometry])
part = CustomPreview(Geometry=move.Geometry, Material=material_2)
boundary = CustomPreview(Geometry=move_2.Geometry, Material=material)
preview = CustomPreview(Geometry=drawbasemesh2d, Material=material_2)
move_3 = Move(Geometry=drawcrossmesh, Motion=pt)  # -> Geometry, Transform

drawcontacts = DrawContacts(Parts=drawstructure.Part, Boundaries=drawstructure.Boundary)
pt_3 = Point(Point(2.5, 0, 0))
move_4 = Move(Geometry=drawcontacts, Motion=pt_3)  # -> Geometry, Transform
