# Grasshopper definition ghscript.gh (Grasshopper 1.0.7)
# plug-ins: TopoGrasshopper Info

panel = Panel("/Users/ziqwang/Documents/GitHub/TopoLockProject/Result/Paper_Render/fig_result_surfaces_opt/ICDPavilion_Hex13.xml")
cluster = Cluster()  # disabled
topocreator = TopoGrasshopperComponent(XMLFile=panel, TiltAngle=Slider(41.733, range=0..90), Preview=Toggle(False))  # -> NumberOfPart, Meshes

# ==== cluster Cluster
M = ClusterInput()
faceb = FaceBoundaries(Mesh=M)
bbox = BoundingBox(Content=flatten(M), Plane=PlaneXY(0, 0, 0))  # -> Box, Box_2
boundary = BoundarySurfaces(Edges=faceb)
debox = DeconstructBox(Box=bbox.Box)  # -> Plane, X, Y, Z
join = BrepJoin(Breps=boundary)  # -> Breps, Closed
dedomain = DeconstructDomain(Domain=debox.Z)  # -> Start, End
sort = SortList(Keys=dedomain.Start)  # -> Keys, ValuesA
fmerge = MergeFaces(Brep=join.Breps)  # -> Breps, Before, After
item = ListItem(List=sort.Keys, Index=0, Wrap=True)
vec = VectorXYZ(XComponent=0, YComponent=0, ZComponent=expr("X*(-1)", item))  # -> Vector, Length
move = Move(Geometry=fmerge.Breps, Motion=vec.Vector)  # -> Geometry, Transform
G = ClusterOutput(move.Geometry)
