# Grasshopper definition minimal_surface_error.gh (Grasshopper 1.0.7)
# plug-ins: TopoGrasshopper Info

panel = Panel("/Users/ziqwang/Documents/GitHub/TopoLockProject/Result/Paper_Render/fig_teaser/origin.xml")
rgb = ColourRGB(Alpha="250", Red="250", Green="250", Blue="250")
toggle = BooleanToggle(True)
pt = Point(Point(2.5, 0, 0))
material = CreateMaterial(Diffuse=rgb, Specular=rgb, Emission=rgb, Transparency=0, Shine=0)
topocreator = TopoGrasshopperComponent(
    XMLFile="/Users/ziqwang/Documents/GitHub/TopoLockProject/Result/Paper_Render/fig_intro_sphere/SphereA80_Hex_T0.0.xml",
    TiltAngle=Slider(9, range=0..80),
    Preview=toggle)  # -> NumberOfPart, Meshes
topocreator_2 = TopoGrasshopperComponent(XMLFile=panel, TiltAngle=Slider(50, range=0..80), Preview=toggle)  # -> NumberOfPart, Meshes
move = Move(Geometry=topocreator_2.Meshes, Motion=pt)  # -> Geometry, Transform
faceb = FaceBoundaries(Mesh=[topocreator.Meshes, move.Geometry])
preview = CustomPreview(Geometry=move.Geometry, Material=material)
preview_2 = CustomPreview(Geometry=topocreator.Meshes, Material=material)
