# Grasshopper definition plane_models.gh (Grasshopper 1.0.7)
# plug-ins: TopoGrasshopper Info

number_slider = Slider(8, range=0..10)
sqgrid = Square(Plane=PlaneXY(0, 0, 0), Size=1, ExtentX=number_slider, ExtentY=number_slider)  # -> flatten(Cells), Points
hexgrid = Hexagonal(Plane=PlaneXY(0, 0, 0), Size=1, ExtentX=number_slider, ExtentY=number_slider)  # -> flatten(Cells), flatten(Points)
inittopo = InitTopo(Reset=Button())
crv = Curve(sqgrid.Cells)
modifycrossmesh = ModifyCrossMesh(TopoPtr=inittopo, Parts=hexgrid.Cells)
modifypara = ModifyPara(APointerOfTopoCreator=modifycrossmesh, Name="cutUpper", Value=Slider(0.111, range=0..0.2))
modifypara_2 = ModifyPara(APointerOfTopoCreator=modifypara, Name="cutLower", Value=Slider(0.114, range=0..0.2))
modifypara_3 = ModifyPara(APointerOfTopoCreator=modifypara_2, Name="tiltAngle", Value=Slider(0, range=0..90))

drawstructure = DrawStructure(TopoPtr=modifypara_3, Preview=Toggle(False))  # -> Part, Boundary
rgb = ColourRGB(Alpha="150", Red="150", Green="150", Blue="150")
rgb_2 = ColourRGB(Alpha="250", Red="250", Green="250", Blue="250")
material = CreateMaterial(Diffuse=rgb, Specular=rgb, Emission=rgb, Transparency=0, Shine=0)
material_2 = CreateMaterial(Diffuse=rgb_2, Specular=rgb_2, Emission=rgb_2, Transparency=0, Shine=0)
wireframe = FaceBoundaries(Mesh=[drawstructure.Part, drawstructure.Boundary])
boundary = CustomPreview(Geometry=drawstructure.Boundary, Material=material)
# Render Mesh
part = CustomPreview(Geometry=drawstructure.Part, Material=material_2)
