# Grasshopper definition test.gh (Grasshopper 1.0.7)
# plug-ins: TopoGrasshopper Info

crv = Curve(<curve referenced from the Rhino model>)
crv_2 = Curve([<curve referenced from the Rhino model> x5])
crv_3 = Curve([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])
inittopo = InitTopo()
inittopo_2 = InitTopo()
modifycrossmesh = ModifyCrossMesh(TopoPtr=inittopo_2, Parts=crv_2, Boundaries=crv)
modifycrossmesh_2 = ModifyCrossMesh(TopoPtr=inittopo, Parts=crv_3)
modifypara = ModifyPara(APointerOfTopoCreator=modifycrossmesh, Name="tiltAngle", Value=Slider(24, range=0..100))
modifypara_2 = ModifyPara(APointerOfTopoCreator=modifycrossmesh_2, Name="tiltAngle", Value=Slider(24, range=0..100))

drawstructure = DrawStructure(TopoPtr=modifypara, Preview=Toggle(False))  # -> Part, Boundary
rgb = ColourRGB(Alpha="150", Red="150", Green="150", Blue="150")
rgb_2 = ColourRGB(Alpha="250", Red="250", Green="250", Blue="250")
material = CreateMaterial(Diffuse=rgb, Specular=rgb, Emission=rgb, Transparency=0, Shine=0)
material_2 = CreateMaterial(Diffuse=rgb_2, Specular=rgb_2, Emission=rgb_2, Transparency=0, Shine=0)
pt = Point(Point(2.5, 0, 0))
move = Move(Geometry=drawstructure.Part, Motion=pt)  # -> Geometry, Transform
move_2 = Move(Geometry=drawstructure.Boundary, Motion=pt)  # -> Geometry, Transform
wireframe = FaceBoundaries(Mesh=[move.Geometry, move_2.Geometry])
part = CustomPreview(Geometry=move.Geometry, Material=material_2)
boundary = CustomPreview(Geometry=move_2.Geometry, Material=material)

drawstructure_2 = DrawStructure(TopoPtr=modifypara_2, Preview=Toggle(False))  # -> Part, Boundary
rgb_3 = ColourRGB(Alpha="150", Red="150", Green="150", Blue="150")
rgb_4 = ColourRGB(Alpha="250", Red="250", Green="250", Blue="250")
material_3 = CreateMaterial(Diffuse=rgb_3, Specular=rgb_3, Emission=rgb_3, Transparency=0, Shine=0)
material_4 = CreateMaterial(Diffuse=rgb_4, Specular=rgb_4, Emission=rgb_4, Transparency=0, Shine=0)
pt_2 = Point(Point(2.5, 0, 0))
move_3 = Move(Geometry=drawstructure_2.Part, Motion=pt_2)  # -> Geometry, Transform
move_4 = Move(Geometry=drawstructure_2.Boundary, Motion=pt_2)  # -> Geometry, Transform
wireframe_2 = FaceBoundaries(Mesh=[move_3.Geometry, move_4.Geometry])
part_2 = CustomPreview(Geometry=move_3.Geometry, Material=material_4)
boundary_2 = CustomPreview(Geometry=move_4.Geometry, Material=material_3)
